% Simulink data dictionary rev3_data.sldd

UC_State = enum(DefaultValue="MC_Off")
  MC_Off = 0
  MC_Init = 1
  Contactor_Closed = 2
  MC_Active = 3
  Contactor_Open = 4
  MC_Discharging = 5
  Fault = 6
  Estop = 7
  Preset = 8
  LVSS_MC_Startup = 9
  LVSS_MC_Shutdown = 10

MC_DC_State = enum(DefaultValue="Disabled")
  Disabled = 0
  Enabled = 1
  Speed_Check = 2
  Active = 3
  Complete = 4

MC_VSM_State = enum(DefaultValue="Start")
  Start = 0
  PC_Init = 1
  PC_Active = 2
  PC_Finish = 3
  Wait = 4
  Ready = 5
  Motor_Running = 6
  Fault = 7
  Shutdown = 14
  Recycle_Power = 15

Sig = Simulink.Signal()

BMS_State = enum(DefaultValue="Open_Contactor")
  Open_Contactor = 0
  Close_Contactor = 1
  Stay_Current = 2